# Grasshopper definition data-generator.gh (Grasshopper 1.0.8)
# plug-ins: RhinoCodePluginGH, LunchBox

vector_xyz = VectorXYZ(XComponent=0, YComponent=0, ZComponent=0)  # -> Vector, Length
construct_domain = ConstructDomain(DomainStart=Slider(0.6, range=0..1), DomainEnd=Slider(1.3, range=0..10))
construct_domain_2 = ConstructDomain(DomainStart=Slider(0.6, range=0..1), DomainEnd=Slider(1.25, range=0..10))
point = Point(vector_xyz.Vector)
number_slider = Slider(1000, range=0..1000)
rectangle = Rectangle(Plane=point, XSize=number_slider, YSize=number_slider, Radius=0)  # -> Rectangle, Length
area = Area(Geometry=rectangle.Rectangle)  # -> Area, Centroid
construct_domain_3 = ConstructDomain(DomainStart=Slider(0.5, range=0..1), DomainEnd=Slider(0.9, range=0..1))
construct_domain_4 = ConstructDomain(DomainStart=Slider(10, range=0..100), DomainEnd=Slider(250, range=0..1000))
construct_domain_5 = ConstructDomain(DomainStart=Slider(60, range=0..100), DomainEnd=Slider(250, range=0..1000))
construct_domain_6 = ConstructDomain(DomainStart=Slider(20, range=0..100), DomainEnd=Slider(60, range=0..1000))
construct_domain_7 = ConstructDomain(DomainStart=Slider(5, range=0..100), DomainEnd=Slider(20, range=0..1000))
number_slider_2 = Slider(8054, range=8000..8400)
addition = Addition(A=number_slider_2, B=Slider(1000, range=0..1000))
random = Random(Range=construct_domain, Number=1, Seed=addition)
random_2 = Random(Range=construct_domain_2, Number=1, Seed=number_slider_2)
random_3 = Random(Range=construct_domain_3, Number=1, Seed=number_slider_2)
scale_nu = ScaleNU(Geometry=rectangle.Rectangle, Plane=area.Centroid, ScaleX=random_2, ScaleY=random, ScaleZ=1)  # -> Geometry, Transform
random_quad_panels = RandomQuadPanels(
    Surface=scale_nu.Geometry,
    UDivisions=Slider(15, range=0..100),
    VDivisions=Slider(70, range=0..100),
    RandomSeed=number_slider_2)
populate_2d = Populate2D(Region=scale_nu.Geometry, Count=Slider(250, range=0..1000), Seed=number_slider_2)
list_length = ListLength(List=random_quad_panels)
voronoi = Voronoi(Points=populate_2d, Boundary=scale_nu.Geometry, BruteForceOverride=False)
multiplication = Multiplication(A=list_length, B=random_3)
random_reduce = RandomReduce(List=random_quad_panels, Reduction=multiplication, Seed=number_slider_2)
list_length_2 = ListLength(List=random_reduce)
boundary_surfaces = BoundarySurfaces(Edges=scale_nu.Geometry)
python_3_script = Python3Script(x=number_slider_2, L=construct_domain_7, M=construct_domain_6, H=construct_domain_5, S=construct_domain_4)  # -> out
# ---------- python_3_script: Python ----------
if x <= 7100:
    print(L)
elif 7100 < x <= 7200:
    print(M)
elif 7200 < x <= 7300:
    print(H)
elif x > 7300:
    print(S)
# ---------- end python_3_script ----------
random_4 = Random(Range=python_3_script, Number=list_length_2, Seed=number_slider_2)
integer = Integer(random_4)
unit_z = UnitZ(Factor=integer)
extrude = Extrude(Base=random_reduce, Direction=unit_z)
panel = Panel("https://climate.onebuilding.org/WMO_Region_4_North_and_Central_America/CAN_Canada/ON_Ontario/CAN_ON_Toronto-Pearson.Intl.AP.716240_TMYx.zip")  # disabled
cap_holes = CapHoles(Brep=extrude)
number_slider_3 = Slider(30, range=0..100)  # disabled
mesh_brep = MeshBrep(
    Brep=cap_holes,
    Settings={GridMaxCount=0, GridMinCount=16, JaggedSeams=False, MaxEdgeLength=0, MinEdgeLength=0.0001, MinTolerance=0, Refine=True, RefineAngle=0, RelativeTolerance=0.65, SimplePlanes=True, Tolerance=0})  # -> flatten(Mesh)
construct_domain_8 = ConstructDomain(DomainStart="-180", DomainEnd="180")
construct_domain_9 = ConstructDomain(DomainStart="-35", DomainEnd="-65")
construct_domain_10 = ConstructDomain(DomainStart="1", DomainEnd="28")
construct_domain_11 = ConstructDomain(DomainStart="6", DomainEnd="7")
downloadepw = LBDownloadWeather(weather_URL=panel)  # -> epw_file, stat_file, ddy_file; disabled; plug-in component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
mesh_join = MeshJoin(Meshes=mesh_brep)
random_5 = Random(Range=construct_domain_8, Number=1, Seed=number_slider_2)
random_6 = Random(Range=construct_domain_9, Number=1, Seed=number_slider_2)
random_7 = Random(Range=construct_domain_10, Number=1, Seed=number_slider_2)
random_8 = Random(Range=construct_domain_11, Number=1, Seed=number_slider_2)
genpts = LBGeneratePointGrid(geometry=boundary_surfaces, grid_size=number_slider_3)  # -> points, vectors, face_areas, mesh; disabled; plug-in component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
importepw = LBImportEPW(epw_file=downloadepw.epw_file)  # -> location, dry_bulb_temperature, dew_point_temperature, relative_humidity, wind_speed, wind_direction, direct_normal_rad, diffuse_horizontal_rad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; disabled; plug-in component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
integer_2 = Integer(random_5)
deconstruct_mesh = DeconstructMesh(Mesh=mesh_join)  # -> Vertices, Faces, Colours, Normals
integer_3 = Integer(random_6)
boolean_toggle = BooleanToggle(True)  # disabled
integer_4 = Integer(random_7)
integer_5 = Integer(random_8)
mesh_join_2 = MeshJoin(Meshes=genpts.mesh)  # disabled
constrloc = LBConstructLocation(latitude=integer_3, longitude=integer_2, elevation=0)  # -> location; plug-in component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
analysisperiod = LBAnalysisPeriod(
    start_month=integer_5,
    start_day=integer_4,
    start_hour=Slider(9, range=0..10),
    end_month=integer_5,
    end_day=integer_4,
    end_hour=Slider(17, range=0..100))  # -> period, hoys, dates; plug-in component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
deconstruct = Deconstruct(Point=deconstruct_mesh.Vertices)  # -> XComponent, YComponent, ZComponent
humantosky = LBHumanToSkyRelation(location=importepw.location, position=flatten(genpts.points), context=flatten(mesh_brep), run=boolean_toggle)  # -> out, human_points, human_line, fract_body_exp, sky_exposure; disabled; plug-in component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
panel_2 = Panel(integer_5)
panel_3 = Panel(integer_4)
panel_4 = Panel(integer_3)
panel_5 = Panel(integer_2)
construct_domain_12 = ConstructDomain(DomainStart=Slider(60, range=0..100), DomainEnd=Slider(255, range=0..1000))
construct_domain_13 = ConstructDomain(DomainStart=Slider(0, range=0..100), DomainEnd=Slider(250, range=0..1000))
panel_6 = Panel(analysisperiod.period)
point_2 = Point(Point(99348.53527, -44044.80513, 0))
remap_numbers = RemapNumbers(Value=deconstruct.ZComponent, Source=construct_domain_13, Target=construct_domain_12)  # -> Mapped, Clipped
number_slider_4 = Slider(17, range=0..100)  # disabled
number_slider_5 = Slider(17, range=0..100)  # disabled
number_slider_6 = Slider(17, range=0..100)  # disabled
number_slider_7 = Slider(17, range=0..100)  # disabled
number_slider_8 = Slider(6, range=0..10)  # disabled
number_slider_9 = Slider(6, range=0..10)  # disabled
number_slider_10 = Slider(21, range=0..100)  # disabled
number_slider_11 = Slider(21, range=0..100)  # disabled
number_slider_12 = Slider(6, range=0..10)  # disabled
number_slider_13 = Slider(8, range=0..10)  # disabled
number_slider_14 = Slider(6, range=0..10)  # disabled
number_slider_15 = Slider(21, range=0..100)  # disabled
number_slider_16 = Slider(8, range=0..10)  # disabled
number_slider_17 = Slider(21, range=0..100)  # disabled
number_slider_18 = Slider(17, range=0..100)  # disabled
number_slider_19 = Slider(8, range=0..10)  # disabled
number_slider_20 = Slider(8, range=0..10)  # disabled
number_slider_21 = Slider(17, range=0..100)  # disabled
number_slider_22 = Slider(6, range=0..10)  # disabled
number_slider_23 = Slider(21, range=0..100)  # disabled
number_slider_24 = Slider(8, range=0..10)  # disabled
number_slider_25 = Slider(6, range=0..10)  # disabled
number_slider_26 = Slider(21, range=0..100)  # disabled
number_slider_27 = Slider(8, range=0..10)  # disabled
sunpath = LBSunPath(location=constrloc, hoys=analysisperiod.hoys, center_pt=point_2, scale=Slider(5, range=0..10))  # -> out, vectors, altitudes, azimuths, hoys, sun_pts, analemma, daily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; plug-in component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
merge = Merge(Data1=boundary_surfaces, Data2=cap_holes)  # -> flatten(Result)
number_slider_28 = Slider(240, range=0..1000)
gradient = Gradient(
    LowerLimit=Slider(0, range=0..100),
    UpperLimit=Slider(255, range=0..1000),
    Parameter=remap_numbers.Mapped,
    stops=[0: RGB(255, 255, 255), 1: RGB(0, 0, 0)])
legendpar = LBLegendParameters(
    min=Slider(0, range=0..100),
    max=Slider(9, range=0..10),
    seg_count=Slider(9, range=0..10),
    num_decimals=Slider(0, range=0..100))  # -> leg_par; plug-in component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
analysisperiod_2 = LBAnalysisPeriod(
    start_month=number_slider_9,
    start_day=number_slider_10,
    start_hour=number_slider_16,
    end_month=number_slider_9,
    end_day=number_slider_10,
    end_hour=number_slider_5)  # -> period, hoys, dates; disabled; plug-in component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
analysisperiod_3 = LBAnalysisPeriod(
    start_month=number_slider_8,
    start_day=number_slider_11,
    start_hour=number_slider_13,
    end_month=number_slider_8,
    end_day=number_slider_11,
    end_hour=number_slider_4)  # -> period, hoys, dates; disabled; plug-in component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
analysisperiod_4 = LBAnalysisPeriod(
    start_month=number_slider_12,
    start_day=number_slider_15,
    start_hour=number_slider_19,
    end_month=number_slider_12,
    end_day=number_slider_15,
    end_hour=number_slider_6)  # -> period, hoys, dates; disabled; plug-in component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
analysisperiod_5 = LBAnalysisPeriod(
    start_month=number_slider_14,
    start_day=number_slider_17,
    start_hour=number_slider_20,
    end_month=number_slider_14,
    end_day=number_slider_17,
    end_hour=number_slider_7)  # -> period, hoys, dates; disabled; plug-in component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
mesh_brep_2 = MeshBrep(
    Brep=merge,
    Settings={GridMaxCount=0, GridMinCount=16, JaggedSeams=False, MaxEdgeLength=0, MinEdgeLength=0.0001, MinTolerance=0, Refine=True, RefineAngle=0, RelativeTolerance=0.65, SimplePlanes=True, Tolerance=0})
analysisperiod_6 = LBAnalysisPeriod(
    start_month=number_slider_22,
    start_day=number_slider_23,
    start_hour=number_slider_24,
    end_month=number_slider_22,
    end_day=number_slider_23,
    end_hour=number_slider_18)  # -> period, hoys, dates; disabled; plug-in component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
analysisperiod_7 = LBAnalysisPeriod(
    start_month=number_slider_25,
    start_day=number_slider_26,
    start_hour=number_slider_27,
    end_month=number_slider_25,
    end_day=number_slider_26,
    end_hour=number_slider_21)  # -> period, hoys, dates; disabled; plug-in component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
colour_rgb = ColourRGB(Alpha=255, Red=number_slider_28, Green=number_slider_28, Blue=number_slider_28)
panel_7 = Panel("E:\InstantSim\training\pytorch-CycleGAN-and-pix2pix\datasets\direct_sun_hours\A_low\South\r")
mesh_join_3 = MeshJoin(Meshes=mesh_brep_2)
directsunhours = LBDirectSunHours(
    vectors=flatten(sunpath.vectors),
    geometry=flatten(merge),
    context=flatten(merge),
    grid_size=Slider(5, range=0..10),
    offset_dist=Slider(0.2, range=0..1),
    legend_par=legendpar,
    run=Toggle(False))  # -> out, points, results, mesh, legend, title, int_mtx; plug-in component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
mesh_brep_3 = MeshBrep(
    Brep=boundary_surfaces,
    Settings={GridMaxCount=0, GridMinCount=16, JaggedSeams=False, MaxEdgeLength=0, MinEdgeLength=0.0001, MinTolerance=0, Refine=True, RefineAngle=0, RelativeTolerance=0.65, SimplePlanes=True, Tolerance=0})
applyper = LBApplyAnalysisPeriod(data=importepw.dry_bulb_temperature, period=analysisperiod_3.period)  # -> data; disabled; plug-in component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
applyper_2 = LBApplyAnalysisPeriod(data=importepw.diffuse_horizontal_rad, period=analysisperiod_4.period)  # -> data; disabled; plug-in component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
applyper_3 = LBApplyAnalysisPeriod(data=importepw.direct_normal_rad, period=analysisperiod_5.period)  # -> data; disabled; plug-in component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
applyper_4 = LBApplyAnalysisPeriod(data=importepw.horizontal_infrared_rad, period=analysisperiod_2.period)  # -> data; disabled; plug-in component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
applyper_5 = LBApplyAnalysisPeriod(data=importepw.relative_humidity, period=analysisperiod_6.period)  # -> data; disabled; plug-in component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
applyper_6 = LBApplyAnalysisPeriod(data=importepw.wind_speed, period=analysisperiod_7.period)  # -> data; disabled; plug-in component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
python_3_script_2 = Python3Script(x=mesh_join_3, y=Toggle(False))  # -> out, a; inputs x: Mesh, y: Boolean
# ---------- python_3_script_2: Python ----------
import clr
import System.Net
import System.Text
import Rhino
import json

# --- 配置 ---
# 这是我们后端的地址
url = "http://127.0.0.1:8000/sync_model"

def sync_mesh(rhino_mesh):
    """提取 Mesh 数据并发送给后端"""
    if rhino_mesh is None:
        return "错误: 请连接一个 Mesh"
        
    # 1. 提取顶点 (Vertices) -> [x,y,z, x,y,z...]
    verts = []
    for v in rhino_mesh.Vertices:
        # Rhino 的坐标直接发过去，前端会负责旋转坐标轴
        verts.append(v.X)
        verts.append(v.Y)
        verts.append(v.Z)
        
    # 2. 提取面 (Faces) -> [a,b,c, a,c,d...]
    faces = []
    for f in rhino_mesh.Faces:
        if f.IsQuad: # 如果是四边面，切成两个三角形
            faces.extend([f.A, f.B, f.C])
            faces.extend([f.A, f.C, f.D])
        else: # 三角面
            faces.extend([f.A, f.B, f.C])
            
    # 3. 构造 JSON Payload
    payload = {
        "vertices": verts,
        "faces": faces
    }
    
    # 4. 发送 POST 请求
    try:
        json_data = json.dumps(payload)
        client = System.Net.WebClient()
        client.Headers.Add("Content-Type", "application/json")
        # 发送！
        response = client.UploadString(url, "POST", json_data)
        return "模型同步成功! (顶点数: {})".format(len(verts)/3)
    except Exception as e:
        return "同步失败: " + str(e)

# --- 入口 ---
# x: 输入的 Mesh
# y: 输入的 Button (布尔值)

msg = "等待同步..."

# 只有当按钮按下 (True) 且模型存在时才运行
if y is True and x is not None:
    msg = sync_mesh(x)

print(msg)
a = msg
# ---------- end python_3_script_2 ----------
python_3_script_3 = Python3Script(buildings=mesh_join, ground=mesh_brep_3, preview=Toggle(False), send=Toggle(False))  # -> out, a; inputs buildings: list of Mesh, ground: list of Mesh, preview: Boolean, send: Boolean
# ---------- python_3_script_3: Python ----------
import Rhino
import System.Drawing
import System.Net
import System.IO
import scriptcontext as sc
import rhinoscriptsyntax as rs

# ==========================================
# 全局配置
# ==========================================
url = "http://127.0.0.1:8000/predict"

safe_temp_dir = System.IO.Path.GetTempPath()
temp_filename = "gh_auto_capture.png"
temp_path = System.IO.Path.Combine(safe_temp_dir, temp_filename)

PREVIEW_TAG = "InstantSim_Preview_Geometry"

# --- 缩放边距系数 (越大边距越宽) ---
# 1.2 代表留出 20% 的空隙，防止贴边
ZOOM_FACTOR = 1.2 

# --- 建筑颜色 (0-195) ---
BUILDING_H_MIN = 0.0    
BUILDING_H_MAX = 250.0  
COLOR_AT_BOTTOM = 195   
COLOR_AT_TOP = 0        

# --- 地面颜色 (固定 240) ---
COLOR_GROUND = 240      

# --- 背景颜色 (固定 255) ---
COLOR_BACKGROUND = 255  
# ==========================================

def create_colored_meshes(building_meshes, ground_meshes):
    meshes_out = []
    # 这个 bbox 只包含建筑和地面，不包含背景板
    bbox = Rhino.Geometry.BoundingBox.Empty

    # 1. 地面
    if ground_meshes:
        if not isinstance(ground_meshes, list): ground_meshes = [ground_meshes]
        ground_color = System.Drawing.Color.FromArgb(COLOR_GROUND, COLOR_GROUND, COLOR_GROUND)
        for g_mesh in ground_meshes:
            if g_mesh and g_mesh.IsValid:
                temp_g = g_mesh.DuplicateMesh()
                temp_g.VertexColors.CreateMonotoneMesh(ground_color)
                temp_g.Normals.ComputeNormals() 
                temp_g.UserDictionary.Set("Tag", PREVIEW_TAG)
                meshes_out.append(temp_g)
                bbox.Union(temp_g.GetBoundingBox(True))

    # 2. 建筑
    if building_meshes:
        if not isinstance(building_meshes, list): building_meshes = [building_meshes]
        joined_buildings = Rhino.Geometry.Mesh()
        for b_mesh in building_meshes:
            if b_mesh and b_mesh.IsValid: 
                joined_buildings.Append(b_mesh)
                bbox.Union(b_mesh.GetBoundingBox(True))
            
        if joined_buildings.IsValid:
            colors = []
            for v in joined_buildings.Vertices:
                z = v.Z
                if z < BUILDING_H_MIN: z = BUILDING_H_MIN
                if z > BUILDING_H_MAX: z = BUILDING_H_MAX
                t = (z - BUILDING_H_MIN) / (BUILDING_H_MAX - BUILDING_H_MIN)
                gray_val = int(COLOR_AT_BOTTOM + t * (COLOR_AT_TOP - COLOR_AT_BOTTOM))
                colors.append(System.Drawing.Color.FromArgb(gray_val, gray_val, gray_val))
            
            joined_buildings.VertexColors.Clear()
            for c in colors: joined_buildings.VertexColors.Add(c)
            joined_buildings.Normals.ComputeNormals()
            joined_buildings.UserDictionary.Set("Tag", PREVIEW_TAG)
            meshes_out.append(joined_buildings)

    # 3. 背景板 (无限大，但不影响 bbox 计算)
    if meshes_out: 
        safe_z = bbox.Min.Z - 50.0 
        bg_plane = Rhino.Geometry.Mesh.CreateFromPlane(
            Rhino.Geometry.Plane.WorldXY, 
            Rhino.Geometry.Interval(-50000, 50000), 
            Rhino.Geometry.Interval(-50000, 50000), 
            10, 10
        )
        bg_plane.Translate(Rhino.Geometry.Vector3d(0, 0, safe_z))
        bg_plane.VertexColors.CreateMonotoneMesh(System.Drawing.Color.FromArgb(COLOR_BACKGROUND, COLOR_BACKGROUND, COLOR_BACKGROUND))
        bg_plane.Normals.ComputeNormals()
        bg_plane.UserDictionary.Set("Tag", PREVIEW_TAG)
        meshes_out.insert(0, bg_plane)

    return meshes_out, bbox

def clear_previous_previews():
    sc.doc = Rhino.RhinoDoc.ActiveDoc
    try:
        all_objects = sc.doc.Objects.FindByObjectType(Rhino.DocObjects.ObjectType.Mesh)
        ids_to_delete = []
        for obj in all_objects:
            if obj.Geometry.UserDictionary.GetString("Tag") == PREVIEW_TAG:
                ids_to_delete.append(obj.Id)
        
        if len(ids_to_delete) > 0:
            for id in ids_to_delete:
                sc.doc.Objects.Delete(id, True)
            sc.doc.Views.Redraw()
            return True
        return False
    finally:
        sc.doc = ghdoc 

def action_preview(b_meshes, g_meshes):
    clear_previous_previews()
    
    meshes, bbox = create_colored_meshes(b_meshes, g_meshes)
    if not meshes: return "数据无效"

    sc.doc = Rhino.RhinoDoc.ActiveDoc 
    try:
        sc.doc.Views.RedrawEnabled = False
        for m in meshes:
            sc.doc.Objects.AddMesh(m)
            
        view = sc.doc.Views.Find("Top", False)
        if view:
            sc.doc.Views.ActiveView = view
            vp = view.ActiveViewport
            
            rendered = Rhino.Display.DisplayModeDescription.FindByName("Rendered")
            if rendered: vp.DisplayMode = rendered
            
            # 核心修改：强制正方形缩放算法
            if bbox.IsValid:
                center = bbox.Center
                dx = bbox.Max.X - bbox.Min.X
                dy = bbox.Max.Y - bbox.Min.Y
                
                # 找出最长的一边
                max_dim = max(dx, dy)
                
                # 创建一个新的、正方形的虚拟包围盒
                # 边长 = 最长边 * 缩放系数 (1.2)
                half_side = (max_dim * ZOOM_FACTOR) / 2.0
                
                target_bbox = Rhino.Geometry.BoundingBox(
                    center.X - half_side, center.Y - half_side, center.Z,
                    center.X + half_side, center.Y + half_side, center.Z
                )
                
                # 让相机对准这个完美的正方形
                vp.ZoomBoundingBox(target_bbox)
            
        return "预览开启 (智能居中)"
    finally:
        sc.doc.Views.RedrawEnabled = True
        sc.doc.Views.Redraw()
        sc.doc = ghdoc 

def action_send(b_meshes, g_meshes):
    msg = action_preview(b_meshes, g_meshes)
    if "x" in msg: return msg

    sc.doc = Rhino.RhinoDoc.ActiveDoc
    try:
        view = sc.doc.Views.Find("Top", False)
        if not view: return "请打开 Top 视图"
        
        sc.doc.Views.Redraw()
        System.Windows.Forms.Application.DoEvents() 
        
        capture = Rhino.Display.ViewCapture()
        capture.Width = 512
        capture.Height = 512
        capture.ScaleScreenItems = False
        capture.DrawGrid = False
        capture.DrawAxes = False
        capture.TransparentBackground = False 
        
        bitmap = capture.CaptureToBitmap(view)
        
        if bitmap is None: return "截图失败"

        bitmap.Save(temp_path, System.Drawing.Imaging.ImageFormat.Png)
        
        if not System.IO.File.Exists(temp_path): return "保存失败"
        
        client = System.Net.WebClient()
        response = client.UploadFile(url, "POST", temp_path)
        
        return "发送成功!"
        
    except Exception as e:
        return "错误: " + str(e)
    finally:
        sc.doc = ghdoc

# --- 消息逻辑 ---
if "last_msg" not in sc.sticky:
    sc.sticky["last_msg"] = "等待指令..."

if send:
    sc.sticky["last_msg"] = action_send(buildings, ground)
elif preview:
    sc.sticky["last_msg"] = action_preview(buildings, ground)
else:
    did_delete = clear_previous_previews()
    if did_delete:
        sc.sticky["last_msg"] = "预览已关闭"

msg = sc.sticky["last_msg"]
print(msg)
# ---------- end python_3_script_3 ----------
mesh_colours = MeshColours(Mesh=mesh_brep_3, Colours=colour_rgb)
panel_8 = Panel(sunpath.vectors)
mesh_colours_2 = MeshColours(Mesh=mesh_join, Colours=gradient)
mesh = Mesh(directsunhours.mesh)
python_3_script_4 = Python3Script(save=Toggle(False), vectors=sunpath.vectors, folder=panel_7)  # -> a; inputs save: Boolean, vectors: list
# ---------- python_3_script_4: Python ----------
import os
import json # 引入 JSON 库

# 初始化输出
a = "0"

if save:
    # 文件名改成 .jsonl (JSON Lines)
    file_path = os.path.join(folder, "data_log.jsonl")
    current_id = 0
    
    # ------------------------------------------------
    # 1. 自动计算 ID (数行数)
    # ------------------------------------------------
    if os.path.exists(file_path):
        try:
            with open(file_path, 'r') as f:
                # 每一行就是一条数据，直接数行数就行
                lines = f.readlines()
                # 过滤空行
                current_id = sum(1 for line in lines if line.strip())
        except:
            current_id = 0
    
    # 格式化 ID 为 4 位字符串
    new_id_str = str(current_id).zfill(4)
    
    # ------------------------------------------------
    # 2. 构建最完美的数据结构 (List of Lists)
    # ------------------------------------------------
    # 确保 vectors 是列表
    if not isinstance(vectors, list):
        vectors = [vectors]
    
    # 把 Rhino 的 Vector3d 对象转成 Python 列表 [x, y, z]
    # 结果是一个二维数组: [[0.1, 0.2, 0.3], [...], ...]
    vec_list = [[round(v.X, 4), round(v.Y, 4), round(v.Z, 4)] for v in vectors]
    
    # 组装字典
    data_entry = {
        "id": new_id_str,
        "vectors": vec_list
    }
    
    # ------------------------------------------------
    # 3. 写入文件 (一行一个 JSON)
    # ------------------------------------------------
    # json.dumps 把字典变成字符串
    json_line = json.dumps(data_entry) + "\n"
    
    try:
        # 'a' 模式追加
        with open(file_path, "a") as f:
            f.write(json_line)
        print("✅ JSONL 记录成功: " + new_id_str)
    except Exception as e:
        print("❌ 写入失败: " + str(e))

    # ------------------------------------------------
    # 4. 把 ID 传给截图脚本
    # ------------------------------------------------
    a = new_id_str
# ---------- end python_3_script_4 ----------
panel_9 = Panel(python_3_script_2.a)
panel_10 = Panel(directsunhours.results)
panel_11 = Panel(python_3_script_3.out)
boolean_toggle_2 = BooleanToggle(False)  # disabled
outdoorsolarmrt = LBOutdoorSolarMRT(
    location=importepw.location,
    surface_temp=applyper,
    dir_norm_rad=applyper_3,
    diff_horiz_rad=applyper_2,
    horiz_infrared=applyper_4,
    sky_exposure=humantosky.sky_exposure,
    run=boolean_toggle_2)  # -> out, short_erf, long_erf, short_dmrt, long_dmrt, mrt; disabled; plug-in component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
boolean_toggle_3 = BooleanToggle(False)  # disabled
utci = LBUTCIComfort(air_temp=applyper, mrt=outdoorsolarmrt.mrt, rel_humid=applyper_5, wind_vel=applyper_6, run=boolean_toggle_3)  # -> out, utci, comfort, condition, category, comf_obj; disabled; plug-in component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
xdata = LBDeconstructData(data=utci.utci)  # -> header, values; disabled; plug-in component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
average = Average(Input=xdata.values)  # -> flatten(ArithmeticMean); disabled
heatmap = LBSpatialHeatmap(values=average, mesh=mesh_join_2)  # -> mesh, legend, title, colors, legend_par, vis_set; disabled; plug-in component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
panel_12 = Panel(average)  # disabled
mesh_2 = Mesh(heatmap.mesh)  # disabled
